# Dynamo graph 1480-MCR.dyn (Dynamo 2.0.0.4654)

categories = Categories(index=245)
all_elements_of_category = ElementsOfCategory(Category=categories)
string = StringInput("Name")
getParameterValueByName = Element.GetParameterValueByName(element=all_elements_of_category, parameterName=string)
string_2 = StringInput("Old_LN_")
string_3 = StringInput("")
replace = String.Replace(str=getParameterValueByName, searchFor=string_2, replaceWith=string_3)
setParameterByName = Element.SetParameterByName(element=all_elements_of_category, parameterName=string, value=replace)  # frozen
watch = Watch(replace)

# group: Export levels
file_path = Filename("AR-1480-KiryatOno-1000-R17_2018-5-23_9.16.37\Levels.xlsx")
string_4 = StringInput("Levels")
number = DoubleInput(0)
boolean = BoolSelector(true)
exportExcel = Data.ExportExcel(filePath=file_path, sheetName=string_4, startRow=number, startCol=number, overWrite=boolean)  # frozen; unwired: data

watch_2 = Watch(exportExcel)
duplicate_options = DuplicateOptionsUi(index=0)
duplicate = archilab.Revit.Views.Views.Duplicate(options=duplicate_options)  # frozen; unwired: view, name
element_types = ElementTypes(index=325)
all_elements_of_type = ElementsOfType(element_type=element_types)

# group: Import exel data
file_path_2 = Filename("D:\Jonathan\_Work\MYS\1480\1000marketing.xlsx")
file_from_path = FileObject(path=file_path_2)
string_5 = StringInput("מכר")
boolean_2 = BoolSelector(false)
importExcel = Data.ImportExcel(file=file_from_path, sheetName=string_5, readAsStrings=boolean_2, showExcel=boolean_2)

watch_3 = Watch(importExcel)
isTitleblockSchedule = archilab.Revit.Views.Views.IsTitleblockSchedule()  # frozen; unwired: view
view_type = ViewTypesUi(index=9)
getByType = archilab.Revit.Views.Views.GetByType(viewType=view_type)
name = Element.Name(element=getByType)
python_script = Python(IN[0]=getByType)
# ---------- python_script.python (44 lines) ----------
# Enable Python support and load DesignScript library
import clr
clr.AddReference('ProtoGeometry')
from Autodesk.DesignScript.Geometry import *


import clr
clr.AddReference('RevitAPI')
from Autodesk.Revit.DB import *
import Autodesk


clr.AddReference("RevitServices")
import RevitServices
from RevitServices.Persistence import DocumentManager

doc = DocumentManager.Instance.CurrentDBDocument

#
p_views = UnwrapElement(IN[0])

levels = []
for v in p_views:
  l = v.GenLevel
  if  l == None:
    levels.append("No level available")
  else:
    levels.append(v.GenLevel)
OUT = levels


# The inputs to this node will be stored as a list in the IN variables.
views = IN[0]

# Place your code below this line


#a = views[0].GetLocation()
a = dir(views[0])
p=[]
#for b in a.Parameters:
#	p.append(b.Value)
#b = a.__getattribute__('level')
OUT = levels
# ----------------------------------------
python_script_2 = Python(IN[0]=importExcel, IN[1]=python_script)  # starter script, not edited (OUT = 0)
view_type_2 = ViewTypesUi(index=9)
getByType_2 = archilab.Revit.Views.Views.GetByType(viewType=view_type_2)
python_script_3 = Python(IN[0]=getByType_2)
# ---------- python_script_3.python (34 lines) ----------
# Enable Python support and load DesignScript library
import clr
clr.AddReference('ProtoGeometry')
from Autodesk.DesignScript.Geometry import *


import clr
clr.AddReference('RevitAPI')
from Autodesk.Revit.DB import *
import Autodesk


clr.AddReference("RevitServices")
import RevitServices
from RevitServices.Persistence import DocumentManager

doc = DocumentManager.Instance.CurrentDBDocument

#
p_views = UnwrapElement(IN[0])

views_data = []
for v in p_views:
	row = []
	row.append(v.Name)
	row.append(v.Scale)
	row.append(v.GenLevel)
	row.append(v.GenLevel.Name)
	row.append(v.ViewTemplateId)
	row.append(v.GetNonControlledTemplateParameterIds())
	views_data.append(row)

OUT = views_data
#OUT = dir(p_views[0])
# ----------------------------------------
viewTemplate = archilab.Revit.Views.Views.ViewTemplate(view=getByType_2)
name_2 = Element.Name(element=getByType_2)
python_script_4 = Python(IN[0]=getByType_2)
# ---------- python_script_4.python (28 lines) ----------
# Enable Python support and load DesignScript library
import clr
clr.AddReference('ProtoGeometry')
from Autodesk.DesignScript.Geometry import *


import clr
clr.AddReference('RevitAPI')
from Autodesk.Revit.DB import *
import Autodesk


clr.AddReference("RevitServices")
import RevitServices
from RevitServices.Persistence import DocumentManager

doc = DocumentManager.Instance.CurrentDBDocument

#
p_views = UnwrapElement(IN[0])

views_data = []
for v in p_views:

	views_data.append(v.Scale)

OUT = views_data
#OUT = dir(p_views[0])
# ----------------------------------------
join = List.Join(list0=getByType_2, list1=viewTemplate, list2=name_2, list3=python_script_4)
file_path_3 = Filename(".\1000marketing.xlsx")
string_6 = StringInput("ViewsData")
number_2 = DoubleInput(0)
list_create = List.Create(item0=getByType_2, item1=python_script_4, item2=name_2, item3=viewTemplate)
transpose = List.Transpose(lists=list_create)
boolean_3 = BoolSelector(true)
exportExcel_2 = Data.ExportExcel(filePath=file_path_3, sheetName=string_6, startRow=number_2, startCol=number_2, data=transpose, overWrite=boolean_3)
watch_4 = Watch(exportExcel_2)
