# Dynamo graph 1480.dyn (Dynamo 2.0.1.5055)

categories = Categories(index=233)
all_elements_of_category = ElementsOfCategory(Category=categories)
python_script = Python(IN[0]=all_elements_of_category)  # frozen; starter script, not edited (OUT = 0)
watch = Watch(python_script)
list_create = List.Create(item0=all_elements_of_category)
string = StringInput("Name")
getParameterValueByName = Element.GetParameterValueByName(element=list_create, parameterName=string, lacing=CrossProduct)  # frozen
file_path = Filename("..\..\Users\jonathant\Desktop\test.xlsx")
string_2 = StringInput("Sheet1")
number = DoubleInput(0)
name = Element.Name(element=list_create)
string_3 = StringInput("Elevation")
getParameterValueByName_2 = Element.GetParameterValueByName(element=list_create, parameterName=string_3, lacing=CrossProduct)
join = List.Join(list0=name, list1=getParameterValueByName_2)
transpose = List.Transpose(lists=join)
boolean = BoolSelector(false)
exportExcel = Data.ExportExcel(filePath=file_path, sheetName=string_2, startRow=number, startCol=number, data=transpose, overWrite=boolean)
watch_2 = Watch(exportExcel)
watch_3 = Watch(transpose)
