# Dynamo graph BeamAlongAWall.dyn (Dynamo 2.0.3.8810)

select_model_elements = DSModelElementsSelection()  # 4 picked in the model
string = StringInput("Wall")
removeIfNot = List.RemoveIfNot(list=select_model_elements, type=string)
getLocation = Element.GetLocation(element=removeIfNot)
level = Custom[Element.Level](element=removeIfNot)  # Gets an element's level
family_types = FamilyTypes(index=347)
beamByCurve = StructuralFraming.BeamByCurve(curve=getLocation, level=level, structuralFramingType=family_types)
orientation = Custom[Wall.Orientation](wall=removeIfNot)  # Gets the orientation of a given wall instance (normal of the exterior face of the wall). Will *not* work for walls hosted on mass faces or in-place walls.
normalized = Vector.Normalized(vector=orientation)
code_block = CodeBlock { 19.5; }
scale = Vector.Scale(vector=normalized, scale_factor=code_block)
moveByVector = Element.MoveByVector(element=beamByCurve, vector=scale)
watch = Watch(moveByVector)
