# Dynamo graph CW_ADD_GRID-Variables.dyn (Dynamo 2.0.3.8810)

# group: divide vertical grid
select_model_element = DSModelElementSelection()  # 1 picked in the model; frozen
ʳʰʸᵗʰᵐ_curtaingrid_bywallelement = Rhythm.Revit.Elements.CurtainGrid.ByWallElement(curtainWall=select_model_element)
grid_size = DoubleSlider(140, range=60..270 step 2.5)  # graph input
getLocation = Element.GetLocation(element=select_model_element)
string = StringInput("Base Offset")
getParameterValueByName = Element.GetParameterValueByName(element=select_model_element, parameterName=string)
python_script = Python(IN[0]=grid_size, IN[1]=getLocation, IN[2]=getParameterValueByName)
# ---------- python_script.python (81 lines) ----------
# Enable Python support and load DesignScript library
import clr
clr.AddReference('ProtoGeometry')
from Autodesk.DesignScript.Geometry import *

import math

# The inputs to this node will be stored as a list in the IN variables.

fix_distance = IN[0]
curveObject = IN[1]

curveLength = curveObject.Length

# Place your code below this line
pattern = []
ptlist =[]
dlist = [] 

wbase = IN[2]
acm_distance = 0.0
num_panels = int(math.floor(curveLength / fix_distance))

v_distance = curveLength - (num_panels * fix_distance)


if num_panels % 2 == 0:
	for x in range(num_panels / 2 ):
		pattern.append("f")
		tpt = curveObject.PointAtSegmentLength(acm_distance + fix_distance)
		tptz = Point.ByCoordinates(tpt.X,tpt.Y,tpt.Z+wbase)
		#ptlist.append(curveObject.PointAtSegmentLength(acm_distance + fix_distance))
		ptlist.append(tptz)
		dlist.append(acm_distance)
		acm_distance += fix_distance
	pattern.append("v")
	tpt = curveObject.PointAtSegmentLength(acm_distance+v_distance)
	tptz = Point.ByCoordinates(tpt.X,tpt.Y,tpt.Z+wbase)
	ptlist.append(tptz)
	
	#ptlist.append(curveObject.PointAtSegmentLength(acm_distance+v_distance))
	dlist.append(acm_distance)
	acm_distance += v_distance
	for x in range(num_panels / 2 ):
		#ptlist.append(curveObject.PointAtSegmentLength(acm_distance + fix_distance))
		tpt = curveObject.PointAtSegmentLength(acm_distance + fix_distance)
		tptz = Point.ByCoordinates(tpt.X,tpt.Y,tpt.Z+wbase)
		ptlist.append(tptz)
		dlist.append(acm_distance)
		acm_distance += fix_distance
else:
	pattern.append("v")
	tpt = curveObject.PointAtSegmentLength(v_distance / 2.0)
	tptz = Point.ByCoordinates(tpt.X,tpt.Y,tpt.Z+wbase)
	ptlist.append(tptz)
	#ptlist.append(curveObject.PointAtSegmentLength(v_distance / 2.0))
	dlist.append(acm_distance)
	acm_distance += v_distance / 2.0
	for x in range(num_panels  ):
		pattern.append("f")
		tpt = curveObject.PointAtSegmentLength (acm_distance + fix_distance)
		tptz = Point.ByCoordinates(tpt.X,tpt.Y,tpt.Z+wbase)
		#ptlist.append(curveObject.PointAtSegmentLength (acm_distance + fix_distance))
		ptlist.append(tptz)
		dlist.append(acm_distance)
		acm_distance += fix_distance
	pattern.append("v")
	
	#ptlist.append(curveObject.PointAtSegmentLength(v_distance / 2.0))
	tpt = curveObject.PointAtSegmentLength(v_distance / 2.0)
	tptz = Point.ByCoordinates(tpt.X,tpt.Y,tpt.Z+wbase)
	ptlist.append(tptz)
	dlist.append(acm_distance)
	acm_distance += v_distance / 2.0
#curveObject = IN[3]	

#Autodesk.DesignScript.Geometry.Curve.  
# Assign your output to the OUT variable.
output = ptlist

OUT = output
# ----------------------------------------
reverse = List.Reverse(list=python_script)
restOfItems = List.RestOfItems(list=reverse)
reverse_2 = List.Reverse(list=restOfItems)
boolean = BoolSelector(false)
ʳʰʸᵗʰᵐ_curtaingrid = Rhythm.Revit.Elements.CurtainGrid.AddGridLineByPoint(curtainGrid=ʳʰʸᵗʰᵐ_curtaingrid_bywallelement.curtainGrid, locationPoint=reverse_2, isUGridline=boolean)

# group: Get all curtain wall types
categories = Categories(index=604)
boolean_2 = BoolSelector(true)
all_family_types_of_category = Custom[All Family Types Of Category](category=categories, toggle=boolean_2)  # Gets all family types/symbols of a given category in the model.
code_block = CodeBlock { "Curtain"; }
kind = Custom[WallType.Kind](wallType=all_family_types_of_category)  # Retrieves the wall kind of a given wall type
eq = code_block == kind
filterByBoolMask = List.FilterByBoolMask(list=all_family_types_of_category, mask=eq)

select_model_element_2 = DSModelElementSelection()  # 1 picked in the model; frozen
code_block_2 = CodeBlock(t1=select_model_element_2)
# ---------- code_block_2.designscript (9 lines) ----------
t2 = Rhythm.CurtainGrid.ByWallElement(t1);
t3 = Dictionary.ValueAtKey(t2, "curtainGrid");
t4 = Dictionary.ValueAtKey(t2, "uGrids");
t5 = Dictionary.ValueAtKey(t2, "vGrids");
t6 = 135;
geometry1 = Elements.Element.GetLocation(t1);
t7 = "Base Offset";
t8 = Elements.Element.GetParameterValueByName(t1, t7);
t9 = false;
# ----------------------------------------
python_script_2 = Python(IN[0]=code_block_2.t6, IN[1]=code_block_2.geometry1, IN[2]=code_block_2.t8)  # same code as python_script
code_block_3 = CodeBlock(t2=python_script_2, t5=code_block_2.t3, t6=code_block_2.t9)
# ---------- code_block_3.designscript (4 lines) ----------
t1 = List.Reverse(t2);
t3 = List.RestOfItems(t1);
t4 = List.Reverse(t3);
element1 = Rhythm.CurtainGrid.AddGridLineByPoint(t5, t4, t6);
# ----------------------------------------

# group: מספר קבוע
number = DoubleInput(1292)
number_2 = DoubleInput(12)
div = number / number_2
watch = Watch(div)

# group: Divide by a number
length = Curve.Length(curve=getLocation)
number_3 = DoubleInput(3)
div_2 = length / number_3
watch_2 = Watch(div_2)

select_model_element_3 = DSModelElementSelection()  # 1 picked in the model
ʳʰʸᵗʰᵐ_curtaingrid_bywallelement_2 = Rhythm.Revit.Elements.CurtainGrid.ByWallElement(curtainWall=select_model_element_3)
min_grid_size = DoubleSlider(120, range=60..270 step 2.5)  # graph input
getLocation_2 = Element.GetLocation(element=select_model_element_3)
string_2 = StringInput("Base Offset")
getParameterValueByName_2 = Element.GetParameterValueByName(element=select_model_element_3, parameterName=string_2)
max_grid_size = DoubleSlider(145, range=60..270 step 2.5)  # graph input
python_script_3 = Python(IN[0]=min_grid_size, IN[1]=getLocation_2, IN[2]=getParameterValueByName_2, IN[3]=max_grid_size)
# ---------- python_script_3.python (96 lines) ----------
# Enable Python support and load DesignScript library
import clr
clr.AddReference('ProtoGeometry')
from Autodesk.DesignScript.Geometry import *
import math
# ------------------------------------------------------------------------
# The inputs to this node will be stored as a list in the IN variables.
min_distance = IN[0]
max_distance = IN[3]

fix_distance =  (min_distance + max_distance) * 0.5


# ------------------------------------------------------------------------
curveObject = IN[1]
# ------------------------------------------------------------------------
curveLength = curveObject.Length
#
num_panels = int(math.floor(curveLength / fix_distance))
# Place your code below this line
pattern = []
ptlist =[]
dlist = [] 

wbase = IN[2]
acm_distance = 0.0

num_panels_by_max = int(math.floor(curveLength / min_distance))
num_panels_by_min = int(math.floor(curveLength / max_distance))

#if num_panels_by_max - num_panels_by_min > 1:
	

dif = [num_panels_by_max ,curveLength / num_panels_by_max ,num_panels_by_min , curveLength/ num_panels_by_min ]


v_distance = curveLength - (num_panels * fix_distance)




if num_panels % 2 == 0:
	for x in range(num_panels / 2 ):
		pattern.append("f")
		tpt = curveObject.PointAtSegmentLength(acm_distance + fix_distance)
		tptz = Point.ByCoordinates(tpt.X,tpt.Y,tpt.Z+wbase)
		#ptlist.append(curveObject.PointAtSegmentLength(acm_distance + fix_distance))
		ptlist.append(tptz)
		dlist.append(acm_distance)
		acm_distance += fix_distance
	pattern.append("v")
	tpt = curveObject.PointAtSegmentLength(acm_distance+v_distance)
	tptz = Point.ByCoordinates(tpt.X,tpt.Y,tpt.Z+wbase)
	ptlist.append(tptz)
	
	#ptlist.append(curveObject.PointAtSegmentLength(acm_distance+v_distance))
	dlist.append(acm_distance)
	acm_distance += v_distance
	for x in range(num_panels / 2 ):
		#ptlist.append(curveObject.PointAtSegmentLength(acm_distance + fix_distance))
		tpt = curveObject.PointAtSegmentLength(acm_distance + fix_distance)
		tptz = Point.ByCoordinates(tpt.X,tpt.Y,tpt.Z+wbase)
		ptlist.append(tptz)
		dlist.append(acm_distance)
		acm_distance += fix_distance
else:
	pattern.append("v")
	tpt = curveObject.PointAtSegmentLength(v_distance / 2.0)
	tptz = Point.ByCoordinates(tpt.X,tpt.Y,tpt.Z+wbase)
	ptlist.append(tptz)
	#ptlist.append(curveObject.PointAtSegmentLength(v_distance / 2.0))
	dlist.append(acm_distance)
	acm_distance += v_distance / 2.0
	for x in range(num_panels  ):
		pattern.append("f")
		tpt = curveObject.PointAtSegmentLength (acm_distance + fix_distance)
		tptz = Point.ByCoordinates(tpt.X,tpt.Y,tpt.Z+wbase)
		#ptlist.append(curveObject.PointAtSegmentLength (acm_distance + fix_distance))
		ptlist.append(tptz)
		dlist.append(acm_distance)
		acm_distance += fix_distance
	pattern.append("v")
	
	#ptlist.append(curveObject.PointAtSegmentLength(v_distance / 2.0))
	tpt = curveObject.PointAtSegmentLength(v_distance / 2.0)
	tptz = Point.ByCoordinates(tpt.X,tpt.Y,tpt.Z+wbase)
	ptlist.append(tptz)
	dlist.append(acm_distance)
	acm_distance += v_distance / 2.0
#curveObject = IN[3]	

#Autodesk.DesignScript.Geometry.Curve.  
# Assign your output to the OUT variable.
output = ptlist

OUT = dif
# ----------------------------------------
reverse_3 = List.Reverse(list=python_script_3)
restOfItems_2 = List.RestOfItems(list=reverse_3)
reverse_4 = List.Reverse(list=restOfItems_2)
boolean_3 = BoolSelector(false)
ʳʰʸᵗʰᵐ_curtaingrid_2 = Rhythm.Revit.Elements.CurtainGrid.AddGridLineByPoint(curtainGrid=ʳʰʸᵗʰᵐ_curtaingrid_bywallelement_2.curtainGrid, locationPoint=reverse_4, isUGridline=boolean_3)  # frozen
watch_3 = Watch(python_script_3)
