# Dynamo graph CW_ADD_GRID.dyn (Dynamo 2.0.3.8810)

grid_size = DoubleSlider(135, range=60..270 step 2.5)  # graph input
select_model_element = DSModelElementSelection()  # 1 picked in the model
ʳʰʸᵗʰᵐ_curtaingrid_bywallelement = Rhythm.Revit.Elements.CurtainGrid.ByWallElement(curtainWall=select_model_element)
getLocation = Element.GetLocation(element=select_model_element)
length = Curve.Length(curve=getLocation)
number = DoubleInput(13)
div = length / number
string = StringInput("Base Offset")
getParameterValueByName = Element.GetParameterValueByName(element=select_model_element, parameterName=string)
simple_division = BoolSelector(true)
python_script = Python(IN[0]=div, IN[1]=getLocation, IN[2]=getParameterValueByName, IN[3]=simple_division)
# ---------- python_script.python (93 lines) ----------
# Enable Python support and load DesignScript library
import clr
clr.AddReference('ProtoGeometry')
from Autodesk.DesignScript.Geometry import *

import math

# The inputs to this node will be stored as a list in the IN variables.

fix_distance = IN[0]
curveObject = IN[1]

curveLength = curveObject.Length

# Place your code below this line
pattern = []
ptlist =[]
dlist = [] 

wbase = IN[2]
simple_division = IN[3]

acm_distance = 0.0


num_panels_flt = curveLength / fix_distance
num_panels = int(math.floor(curveLength / fix_distance))
v_distance = curveLength - (num_panels * fix_distance)



if simple_division:
	for x in range(int(num_panels_flt)):
		tpt = curveObject.PointAtSegmentLength((x+1)*fix_distance)
		tptz = Point.ByCoordinates(tpt.X,tpt.Y,tpt.Z+wbase)
		ptlist.append(tptz)
else :
	if num_panels % 2 == 0:
		for x in range(num_panels / 2 ):
			pattern.append("f")
			tpt = curveObject.PointAtSegmentLength(acm_distance + fix_distance)
			tptz = Point.ByCoordinates(tpt.X,tpt.Y,tpt.Z+wbase)
			#ptlist.append(curveObject.PointAtSegmentLength(acm_distance + fix_distance))
			ptlist.append(tptz)
			dlist.append(acm_distance)
			acm_distance += fix_distance
		pattern.append("v")
		tpt = curveObject.PointAtSegmentLength(acm_distance+v_distance)
		tptz = Point.ByCoordinates(tpt.X,tpt.Y,tpt.Z+wbase)
		ptlist.append(tptz)
		
		#ptlist.append(curveObject.PointAtSegmentLength(acm_distance+v_distance))
		dlist.append(acm_distance)
		acm_distance += v_distance
		for x in range(num_panels / 2 ):
			#ptlist.append(curveObject.PointAtSegmentLength(acm_distance + fix_distance))
			tpt = curveObject.PointAtSegmentLength(acm_distance + fix_distance)
			tptz = Point.ByCoordinates(tpt.X,tpt.Y,tpt.Z+wbase)
			ptlist.append(tptz)
			dlist.append(acm_distance)
			acm_distance += fix_distance
	else:
		pattern.append("v")
		tpt = curveObject.PointAtSegmentLength(v_distance / 2.0)
		tptz = Point.ByCoordinates(tpt.X,tpt.Y,tpt.Z+wbase)
		ptlist.append(tptz)
		#ptlist.append(curveObject.PointAtSegmentLength(v_distance / 2.0))
		dlist.append(acm_distance)
		acm_distance += v_distance / 2.0
		for x in range(num_panels  ):
			pattern.append("f")
			tpt = curveObject.PointAtSegmentLength (acm_distance + fix_distance)
			tptz = Point.ByCoordinates(tpt.X,tpt.Y,tpt.Z+wbase)
			#ptlist.append(curveObject.PointAtSegmentLength (acm_distance + fix_distance))
			ptlist.append(tptz)
			dlist.append(acm_distance)
			acm_distance += fix_distance
		pattern.append("v")
		
		#ptlist.append(curveObject.PointAtSegmentLength(v_distance / 2.0))
		tpt = curveObject.PointAtSegmentLength(v_distance / 2.0)
		tptz = Point.ByCoordinates(tpt.X,tpt.Y,tpt.Z+wbase)
		ptlist.append(tptz)
		dlist.append(acm_distance)
		acm_distance += v_distance / 2.0
#curveObject = IN[3]	
if (not simple_division):
	ptlist = ptlist[:-1]
#Autodesk.DesignScript.Geometry.Curve.  
# Assign your output to the OUT variable.
output = ptlist

OUT = output
# ----------------------------------------
boolean = BoolSelector(false)
ʳʰʸᵗʰᵐ_curtaingrid = Rhythm.Revit.Elements.CurtainGrid.AddGridLineByPoint(curtainGrid=ʳʰʸᵗʰᵐ_curtaingrid_bywallelement.curtainGrid, locationPoint=python_script, isUGridline=boolean)

# group: Get all curtain wall types
categories = Categories(index=604)
boolean_2 = BoolSelector(true)
all_family_types_of_category = Custom[All Family Types Of Category](category=categories, toggle=boolean_2)  # Gets all family types/symbols of a given category in the model.
code_block = CodeBlock { "Curtain"; }
kind = Custom[WallType.Kind](wallType=all_family_types_of_category)  # Retrieves the wall kind of a given wall type
eq = code_block == kind
filterByBoolMask = List.FilterByBoolMask(list=all_family_types_of_category, mask=eq)

select_model_element_2 = DSModelElementSelection()  # 1 picked in the model; frozen
code_block_2 = CodeBlock(t1=select_model_element_2)
# ---------- code_block_2.designscript (9 lines) ----------
t2 = Rhythm.CurtainGrid.ByWallElement(t1);
t3 = Dictionary.ValueAtKey(t2, "curtainGrid");
t4 = Dictionary.ValueAtKey(t2, "uGrids");
t5 = Dictionary.ValueAtKey(t2, "vGrids");
t6 = 135;
geometry1 = Elements.Element.GetLocation(t1);
t7 = "Base Offset";
t8 = Elements.Element.GetParameterValueByName(t1, t7);
t9 = false;
# ----------------------------------------
python_script_2 = Python(IN[0]=code_block_2.t6, IN[1]=code_block_2.geometry1, IN[2]=code_block_2.t8)
# ---------- python_script_2.python (81 lines) ----------
# Enable Python support and load DesignScript library
import clr
clr.AddReference('ProtoGeometry')
from Autodesk.DesignScript.Geometry import *

import math

# The inputs to this node will be stored as a list in the IN variables.

fix_distance = IN[0]
curveObject = IN[1]

curveLength = curveObject.Length

# Place your code below this line
pattern = []
ptlist =[]
dlist = [] 

wbase = IN[2]
acm_distance = 0.0
num_panels = int(math.floor(curveLength / fix_distance))

v_distance = curveLength - (num_panels * fix_distance)


if num_panels % 2 == 0:
	for x in range(num_panels / 2 ):
		pattern.append("f")
		tpt = curveObject.PointAtSegmentLength(acm_distance + fix_distance)
		tptz = Point.ByCoordinates(tpt.X,tpt.Y,tpt.Z+wbase)
		#ptlist.append(curveObject.PointAtSegmentLength(acm_distance + fix_distance))
		ptlist.append(tptz)
		dlist.append(acm_distance)
		acm_distance += fix_distance
	pattern.append("v")
	tpt = curveObject.PointAtSegmentLength(acm_distance+v_distance)
	tptz = Point.ByCoordinates(tpt.X,tpt.Y,tpt.Z+wbase)
	ptlist.append(tptz)
	
	#ptlist.append(curveObject.PointAtSegmentLength(acm_distance+v_distance))
	dlist.append(acm_distance)
	acm_distance += v_distance
	for x in range(num_panels / 2 ):
		#ptlist.append(curveObject.PointAtSegmentLength(acm_distance + fix_distance))
		tpt = curveObject.PointAtSegmentLength(acm_distance + fix_distance)
		tptz = Point.ByCoordinates(tpt.X,tpt.Y,tpt.Z+wbase)
		ptlist.append(tptz)
		dlist.append(acm_distance)
		acm_distance += fix_distance
else:
	pattern.append("v")
	tpt = curveObject.PointAtSegmentLength(v_distance / 2.0)
	tptz = Point.ByCoordinates(tpt.X,tpt.Y,tpt.Z+wbase)
	ptlist.append(tptz)
	#ptlist.append(curveObject.PointAtSegmentLength(v_distance / 2.0))
	dlist.append(acm_distance)
	acm_distance += v_distance / 2.0
	for x in range(num_panels  ):
		pattern.append("f")
		tpt = curveObject.PointAtSegmentLength (acm_distance + fix_distance)
		tptz = Point.ByCoordinates(tpt.X,tpt.Y,tpt.Z+wbase)
		#ptlist.append(curveObject.PointAtSegmentLength (acm_distance + fix_distance))
		ptlist.append(tptz)
		dlist.append(acm_distance)
		acm_distance += fix_distance
	pattern.append("v")
	
	#ptlist.append(curveObject.PointAtSegmentLength(v_distance / 2.0))
	tpt = curveObject.PointAtSegmentLength(v_distance / 2.0)
	tptz = Point.ByCoordinates(tpt.X,tpt.Y,tpt.Z+wbase)
	ptlist.append(tptz)
	dlist.append(acm_distance)
	acm_distance += v_distance / 2.0
#curveObject = IN[3]	

#Autodesk.DesignScript.Geometry.Curve.  
# Assign your output to the OUT variable.
output = ptlist

OUT = output
# ----------------------------------------
code_block_3 = CodeBlock(t2=python_script_2, t5=code_block_2.t3, t6=code_block_2.t9)
# ---------- code_block_3.designscript (4 lines) ----------
t1 = List.Reverse(t2);
t3 = List.RestOfItems(t1);
t4 = List.Reverse(t3);
element1 = Rhythm.CurtainGrid.AddGridLineByPoint(t5, t4, t6);
# ----------------------------------------

# group: מספר קבוע
number_2 = DoubleInput(1292)
number_3 = DoubleInput(12)
div_2 = number_2 / number_3
watch = Watch(div_2)

watch_2 = Watch(div)
watch_3 = Watch(python_script)
