# Dynamo graph CW_Remove_all_v_grids.dyn (Dynamo 2.0.3.8810)

delete = archilab.Revit.Elements.Elements.Delete()  # unwired: element
select_model_element = DSModelElementSelection()  # 1 picked in the model
ʳʰʸᵗʰᵐ_curtaingrid_bywallelement = Rhythm.Revit.Elements.CurtainGrid.ByWallElement(curtainWall=select_model_element)
delete_2 = archilab.Revit.Elements.Elements.Delete(element=ʳʰʸᵗʰᵐ_curtaingrid_bywallelement.vGrids)
