# Dynamo graph Pergola Built up.dyn (Dynamo 2.0.3.8810)

# group: Lines selection
קו_פרגולה_פנימי = DSModelElementSelection()  # 1 picked in the model; graph input
getLocation = Element.GetLocation(element=קו_פרגולה_פנימי)
קו_פרגולה_חיצוני = DSModelElementSelection()  # 1 picked in the model; graph input
getLocation_2 = Element.GetLocation(element=קו_פרגולה_חיצוני)

# group: וקטור בין שני הקווים
code_block = CodeBlock { 0.5; }
pointAtParameter = Curve.PointAtParameter(curve=getLocation, param=code_block)
pointAtParameter_2 = Curve.PointAtParameter(curve=getLocation_2, param=code_block)
byTwoPoints = Vector.ByTwoPoints(start=pointAtParameter, end=pointAtParameter_2)

normalized = Vector.Normalized(vector=byTwoPoints)

# group: Spacing
מרחק_בין_קורות_ראשיות = DoubleInput(230)  # graph input
מרווח_בין_קורות_משניות = DoubleInput(22)  # graph input

# group: Level
קומה = Levels(index=1)  # graph input

# group: קורות ראשיות
startPoint = Curve.StartPoint(curve=getLocation)
length = Curve.Length(curve=getLocation)
div = length / מרחק_בין_קורות_ראשיות
floor = Math.Floor(number=div)
pointsAtEqualSegmentLength = Curve.PointsAtEqualSegmentLength(curve=getLocation, divisions=floor)
endPoint = Curve.EndPoint(curve=getLocation)
join = List.Join(list0=startPoint, list1=pointsAtEqualSegmentLength, list2=endPoint)
number = DoubleInput(0)
גובה_קורות_ראשיות = DoubleInput(500)  # graph input
byCoordinates = Vector.ByCoordinates(x=number, y=number, z=גובה_קורות_ראשיות)
add = Point.Add(point=join, vectorToAdd=byCoordinates)
add_2 = Point.Add(point=join, vectorToAdd=byTwoPoints)
add_3 = Point.Add(point=add_2, vectorToAdd=byCoordinates)
byStartPointEndPoint = Line.ByStartPointEndPoint(startPoint=add, endPoint=add_3)
קורות_ראשיות = StructuralFramingTypes(index=13)  # graph input
beamByCurve = StructuralFraming.BeamByCurve(curve=byStartPointEndPoint, level=קומה, structuralFramingType=קורות_ראשיות)

# group: קורת סגירה
startPoint_2 = Curve.StartPoint(curve=getLocation_2)
number_2 = DoubleInput(0)
גובה_קורה_סוגרת = DoubleInput(500)  # graph input
byCoordinates_2 = Vector.ByCoordinates(x=number_2, y=number_2, z=גובה_קורה_סוגרת)
add_4 = Point.Add(point=startPoint_2, vectorToAdd=byCoordinates_2)
endPoint_2 = Curve.EndPoint(curve=getLocation_2)
add_5 = Point.Add(point=endPoint_2, vectorToAdd=byCoordinates_2)
byStartPointEndPoint_2 = Line.ByStartPointEndPoint(startPoint=add_4, endPoint=add_5)
קורה_סוגרת = StructuralFramingTypes(index=6)  # graph input
beamByCurve_2 = StructuralFraming.BeamByCurve(curve=byStartPointEndPoint_2, level=קומה, structuralFramingType=קורה_סוגרת)
passthrough = Custom[Passthrough](passThrough=beamByCurve_2, waitFor=beamByCurve)  # Forces a sequential order of execution. The node wired into the output of the Passthrough node will be executed *after* the node wired into the waitFor input (e.g. important for some Revit operations). The value of the passThrough input will be passed on to the node wired into the output port of the Passthrough node.

# group: קורות משניות
number_3 = DoubleInput(0)
גובה_קורות_משניות = DoubleInput(495)  # graph input
byCoordinates_3 = Vector.ByCoordinates(x=number_3, y=number_3, z=גובה_קורות_משניות)
python_script = Python(IN[0]=join, IN[1]=byTwoPoints, IN[2]=מרווח_בין_קורות_משניות, IN[3]=byCoordinates_3)
# ---------- python_script.python (59 lines) ----------
import clr
import math
#----------------------------------------------------
clr.AddReference('RevitAPI')
from Autodesk.Revit.DB import *
from Autodesk.Revit.DB.Structure import *
#----------------------------------------------------
clr.AddReference('RevitAPIUI')
from Autodesk.Revit.UI import *
#----------------------------------------------------
clr.AddReference('System')
from System.Collections.Generic import List
#----------------------------------------------------
clr.AddReference('RevitNodes')
import Revit
clr.ImportExtensions(Revit.GeometryConversion)
clr.ImportExtensions(Revit.Elements)
#----------------------------------------------------
clr.AddReference('RevitServices')
import RevitServices
from RevitServices.Persistence import DocumentManager
from RevitServices.Transactions import TransactionManager
#----------------------------------------------------
clr.AddReference('ProtoGeometry')
from Autodesk.DesignScript.Geometry import Line

doc = DocumentManager.Instance.CurrentDBDocument
uidoc=DocumentManager.Instance.CurrentUIApplication.ActiveUIDocument
#----------------------------------------------------
#Preparing input from dynamo to revit
# elements = UnwrapElement(IN[0])
#----------------------------------------------------
pts = IN[0]
vctr = IN[1]
spacing = IN[2]

starting_ptlist = []
md = vctr.Length
for x in range(len(pts) - 1):
	starting_ptlist.append([pts[x],pts[x+1]])

rep = int(math.floor(md / spacing))
v = vctr.Normalized() 
sublines = [] 
for l in starting_ptlist:
	f = Line.ByStartPointEndPoint(l[0],l[1])
	for r in range(rep):
		nl = f.Translate(v.Scale(spacing * (r + 1))).Translate(IN[3])
		sublines.append(nl)


#Do some action in a Transaction
TransactionManager.Instance.EnsureInTransaction(doc)
# do something
TransactionManager.Instance.TransactionTaskDone()
#----------------------------------------------------
output = sublines 

OUT = output
# ----------------------------------------
קורות_משניות = StructuralFramingTypes()  # nothing selected; graph input
beamByCurve_3 = StructuralFraming.BeamByCurve(curve=python_script, level=קומה, structuralFramingType=קורות_משניות)
passthrough_2 = Custom[Passthrough](passThrough=beamByCurve_3, waitFor=passthrough)

# group: קבוצה
list_create = List.Create(item0=beamByCurve, item1=passthrough, item2=passthrough_2)
flatten = List.Flatten(list=list_create)
שם_קבוצה_model_group = StringInput("DynamoPergola")
fromElements = Custom[Group.FromElements](elements=flatten, groupName=שם_קבוצה_model_group)  # Creates a group from a list of Revit elements
