# Dynamo graph RoomRenmuber.dyn (Dynamo 2.0.3.8810)

select_model_element = DSModelElementSelection()  # 1 picked in the model
curve = CurveElement.Curve(curveElement=select_model_element)
categories = Categories(index=425)
all_elements_of_category = ElementsOfCategory(Category=categories)
location = Room.Location(room=all_elements_of_category)
closestPointTo = Geometry.ClosestPointTo(geometry=curve, other=location)
parameterAtPoint = Curve.ParameterAtPoint(curve=curve, point=closestPointTo)
watch = Watch(parameterAtPoint)
geometry = Element.Geometry(element=all_elements_of_category)
sortIndexByValue = List.SortIndexByValue(list=parameterAtPoint)
watch_2 = Watch(sortIndexByValue)
string = StringInput("Number")
number = DoubleInput(1)
add = number + sortIndexByValue
string_from_object = FromObject(obj=add)
setParameterByName = Element.SetParameterByName(element=all_elements_of_category, parameterName=string, value=string_from_object)
number_2 = Room.Number(room=all_elements_of_category)
