# Dynamo graph Walls-JoinOnOff.dyn (Dynamo 2.0.3.8810)

select_model_elements = DSModelElementsSelection()  # 233 picked in the model
string = StringInput("Wall")
removeIfNot = List.RemoveIfNot(list=select_model_elements, type=string)
allow_auto_join = BoolSelector(false)
python_script = Python(IN[0]=removeIfNot, IN[1]=allow_auto_join)
# ---------- python_script.python (55 lines) ----------
import clr
#----------------------------------------------------
clr.AddReference('RevitAPI')
from Autodesk.Revit.DB import *
from Autodesk.Revit.DB.Structure import *
#----------------------------------------------------
clr.AddReference('RevitAPIUI')
from Autodesk.Revit.UI import *
#----------------------------------------------------
clr.AddReference('System')
from System.Collections.Generic import List
#----------------------------------------------------
clr.AddReference('RevitNodes')
import Revit
clr.ImportExtensions(Revit.GeometryConversion)
clr.ImportExtensions(Revit.Elements)
#----------------------------------------------------
clr.AddReference('RevitServices')
import RevitServices
from RevitServices.Persistence import DocumentManager
from RevitServices.Transactions import TransactionManager
#----------------------------------------------------
doc = DocumentManager.Instance.CurrentDBDocument
uidoc=DocumentManager.Instance.CurrentUIApplication.ActiveUIDocument
#----------------------------------------------------
#Preparing input from dynamo to revit
# elements = UnwrapElement(IN[0])
#----------------------------------------------------
if isinstance(IN[0],list):
	elements=UnwrapElement(IN[0])
else:
	elements=[UnwrapElement(IN[0])]
output = []

#Do some action in a Transaction

allow = IN[1]

TransactionManager.Instance.EnsureInTransaction(doc)
# do something

if allow:
	for wall in elements:
		WallUtils.AllowWallJoinAtEnd(wall,0)
		WallUtils.AllowWallJoinAtEnd(wall,1)
		output.append(wall)
else:
	for wall in elements:
		WallUtils.DisallowWallJoinAtEnd(wall,0)
		WallUtils.DisallowWallJoinAtEnd(wall,1)
		output.append(wall)
#
TransactionManager.Instance.TransactionTaskDone()
#----------------------------------------------------
OUT = output
# ----------------------------------------
watch = Watch(python_script)
