# Dynamo graph area-rent-common.dyn (Dynamo 2.0.3.8810)

# group: Area scheme select
element_types = ElementTypes(index=18)  # graph input
all_elements_of_type = ElementsOfType(element_type=element_types)
string = StringInput("Name")  # graph input
getParameterValueByName = Element.GetParameterValueByName(element=all_elements_of_type, parameterName=string)
string_2 = StringInput("מכר")  # graph input; frozen
number = DoubleInput(1)  # graph input
getItemAtIndex = List.GetItemAtIndex(list=all_elements_of_type, index=number)

# group: Collect all Areas from a specific level
categories = Categories(index=73)
all_elements_of_category = ElementsOfCategory(Category=categories)
string_3 = StringInput("Level")  # graph input
getParameterValueByName_2 = Element.GetParameterValueByName(element=all_elements_of_category, parameterName=string_3)
choose_level = Levels(index=0)  # graph input
string_4 = StringInput("Name")  # graph input
getParameterValueByName_3 = Element.GetParameterValueByName(element=choose_level, parameterName=string_4)
eq = getParameterValueByName_2 == getParameterValueByName_3
filterByBoolMask = List.FilterByBoolMask(list=all_elements_of_category, mask=eq)

# group: Filter areas by area scheme
string_5 = StringInput("Area Scheme Id")  # graph input
getParameterValueByName_4 = Element.GetParameterValueByName(element=filterByBoolMask.in, parameterName=string_5)
equals = List.Equals(objectA=getParameterValueByName_4, objectB=getItemAtIndex, lacing=CrossProduct)
number_2 = DoubleInput(1)  # graph input
flatten = List.Flatten(list=equals, amt=number_2)
filterByBoolMask_2 = List.FilterByBoolMask(list=filterByBoolMask.in, mask=flatten)

# group: Filter Balconies
string_6 = StringInput("Name")  # graph input
getParameterValueByName_5 = Element.GetParameterValueByName(element=filterByBoolMask_2.in, parameterName=string_6)
string_7 = StringInput("מרפסת")  # graph input
eq_2 = getParameterValueByName_5 == string_7
filterByBoolMask_3 = List.FilterByBoolMask(list=filterByBoolMask_2.in, mask=eq_2)

# group: Filter common area
string_8 = StringInput("Name")  # graph input
getParameterValueByName_6 = Element.GetParameterValueByName(element=filterByBoolMask_3.in, parameterName=string_8)
string_9 = StringInput("משותף")  # graph input
eq_3 = getParameterValueByName_6 == string_9
filterByBoolMask_4 = List.FilterByBoolMask(list=filterByBoolMask_2.in, mask=eq_3)

string_10 = StringInput("Name")  # graph input
getParameterValueByName_7 = Element.GetParameterValueByName(element=filterByBoolMask_4.out, parameterName=string_10)
string_11 = StringInput("מרפסת")  # graph input
contains = String.Contains(str=getParameterValueByName_7, searchFor=string_11)
filterByBoolMask_5 = List.FilterByBoolMask(list=filterByBoolMask_4.out, mask=contains)
string_12 = StringInput("Area")  # graph input
getParameterValueByName_8 = Element.GetParameterValueByName(element=filterByBoolMask_5.out, parameterName=string_12)

# group: Sum of rentable Areas
string_13 = StringInput("Area")  # graph input
getParameterValueByName_9 = Element.GetParameterValueByName(element=filterByBoolMask_5.out, parameterName=string_13)
sum = Math.Sum(values=getParameterValueByName_9)

div = getParameterValueByName_8 / sum

# group: Sum of common Areas
string_14 = StringInput("Area")  # graph input
getParameterValueByName_10 = Element.GetParameterValueByName(element=filterByBoolMask_4.in, parameterName=string_14)
sum_2 = Math.Sum(values=getParameterValueByName_10)

mul = div * sum_2
watch = Watch(mul)
add = getParameterValueByName_8 + mul
watch_2 = Watch(add)
string_15 = StringInput("RevisedArea")  # graph input
setParameterByName = Element.SetParameterByName(element=filterByBoolMask_5.out, parameterName=string_15, value=add)
watch_3 = Watch(setParameterByName)
watch_4 = Watch(div)
watch_5 = Watch(sum)
