# Dynamo graph collectPinfo.dyn (Dynamo 1.3.3.4111)

file_path = Filename("..\mys-wip\report.xlsx")
string = StringInput("Families")
number = DoubleInput(1)

# group: All families
element_types = ElementTypes("Family")
all_elements_of_type = ElementsOfType(element_types)
python_script = Python(IN[0]=all_elements_of_type)
# ---------- python_script.python (13 lines) ----------
import clr
clr.AddReference('ProtoGeometry')
from Autodesk.DesignScript.Geometry import *
#The inputs to this node will be stored as a list in the IN variables.
datain = IN

#Assign your output to the OUT variable.
a = []  #datain[0][0].Name
for d in datain[0]:
	a.append(d.Name)


OUT = a
# ----------------------------------------

boolean = BoolSelector(true)
writeToFile = Excel.WriteToFile(filePath=file_path, sheetName=string, startRow=number, startCol=number, data=python_script, overWrite=boolean)  # frozen
watch = Watch(writeToFile)

# group: Create report name - model + date
string_2 = StringInput("MYS-ModelReport-")
now = DateTime.Now()
string_3 = StringInput("yyyy-MM-dd")
format = DateTime.Format(now, string_3)
string_4 = StringInput(".xslx")
concat = String.Concat(string_2, format, string_4)
python_script_2 = Python(IN[0]=concat)
# ---------- python_script_2.python (36 lines) ----------
import clr

import sys
sys.path.append(r'C:\Program Files (x86)\IronPython 2.7\Lib')
import os   
# importing os without appending to path raises Import Error


clr.AddReference('ProtoGeometry')
from Autodesk.DesignScript.Geometry import *

#The inputs to this node will be stored as a list in the IN variables.
dataEnteringNode = IN


clr.AddReference('RevitAPI')
clr.AddReference('RevitServices')

from Autodesk.Revit.ApplicationServices import *
from Autodesk.Revit.DB import *
import RevitServices
from RevitServices.Persistence import DocumentManager
from RevitServices.Transactions import TransactionManager

doc = DocumentManager.Instance.CurrentDBDocument
uiapp = DocumentManager.Instance.CurrentUIApplication
app = uiapp.Application
uidoc=DocumentManager.Instance.CurrentUIApplication.ActiveUIDocument


fp = BasicFileInfo.Extract(doc.PathName).CentralPath

d = os.path.splitext(fp)[0] + dataEnteringNode[0]

#Assign your output to the OUT variable.
OUT = d
# ----------------------------------------
watch_2 = Watch(python_script_2)

# group: Python - available modules
python_script_3 = Python()  # unwired: IN[0]
# ---------- python_script_3.python (12 lines) ----------
import clr
import System

#dataEnteringNode = IN

mods = None
for a in System.AppDomain.CurrentDomain.GetAssemblies():
	if 'IronPython.Modules' == a.GetName().Name:
		mods = a 
		break
if mods is not None:
	OUT = [m.Key for m in mods.IronPython.Modules]
# ----------------------------------------
watch_3 = Watch(python_script_3)

watch_4 = Watch(all_elements_of_type)
types = Family.Types(all_elements_of_type)
watch_5 = Watch(types)
string_5 = StringInput("Families_Types\n")
python_script_4 = Python(IN[0]=types)
# ---------- python_script_4.python (14 lines) ----------
import clr
clr.AddReference('ProtoGeometry')
from Autodesk.DesignScript.Geometry import *
#The inputs to this node will be stored as a list in the IN variables.
datain = IN

#Assign your output to the OUT variable.
a = []  #datain[0][0].Name
for d in datain[0]:
	for b in d :
		a.append({b.Family , b.Name})


OUT = a
# ----------------------------------------
writeToFile_2 = Excel.WriteToFile(filePath=file_path, sheetName=string_5, startRow=number, startCol=number, data=python_script_4, overWrite=boolean)  # frozen
avaiablePythonModules = Custom[AvaiablePythonModules]()  # This nodes lists all the ootb avaiable python modules
watch_6 = Watch(avaiablePythonModules)
