# Dynamo graph create-levels-by-excel.dyn (Dynamo 2.0.1.5055)

# group: Create levels rom excel
file_path = Filename("X:\!-Israel\1512 Planning of Ala Bnei Brak\02-Drawings\Revit\data\levels.xlsx")
file_from_path = FileObject(path=file_path)
string = StringInput("Levels")
boolean = BoolSelector(false)
importExcel = Data.ImportExcel(file=file_from_path, sheetName=string, readAsStrings=boolean, showExcel=boolean)
number = DoubleInput(1)
getItemAtIndex = List.GetItemAtIndex(list=importExcel, index=number, lacing=CrossProduct)
number_2 = DoubleInput(100)
mul = getItemAtIndex * number_2
watch = Watch(mul)
number_3 = DoubleInput(2)
getItemAtIndex_2 = List.GetItemAtIndex(list=importExcel, index=number_3, lacing=CrossProduct)
watch_2 = Watch(getItemAtIndex_2)
byElevationAndName = Level.ByElevationAndName(elevation=watch, name=watch_2)

python_script = Python()  # frozen; unwired: IN[0]
# ---------- python_script.python (31 lines) ----------
# Enable Python support and load DesignScript library
import clr
# clr.AddReference('ProtoGeometry')
# from Autodesk.DesignScript.Geometry import *
clr.AddReference('RevitServices')

import RevitServices
from RevitServices.Persistence import DocumentManager
from RevitServices.Transactions import TransactionManager


doc = DocumentManager.InstanceCurrentDBDocument

levelstodelete = IN[0]
deleted = []
#from Autodesk.DesignScript.Geometry import *

# The inputs to this node will be stored as a list in the IN variables.

TransactionManager.Instance.EnsureInTransaction(doc)
for ld in levelstodelete:
	doc.Delete(ld)
	deleted.append(ld)

TransactionManager.Instance.TransactionDone()

	
# Place your code below this line

# Assign your output to the OUT variable.
OUT = deleted
# ----------------------------------------
element_types = ElementTypes(index=168)
all_elements_of_type = ElementsOfType(element_type=element_types)
string_2 = StringInput("Name")
string_3 = StringInput("Old_LN_")
getParameterValueByName = Element.GetParameterValueByName(element=all_elements_of_type, parameterName=string_2)
add = string_3 + getParameterValueByName
setParameterByName = Element.SetParameterByName(element=all_elements_of_type, parameterName=string_2, value=add)  # frozen
