# Dynamo graph levelsrename.dyn (Dynamo 2.0.3.8810)

categories = Categories(index=248)
all_elements_of_category = ElementsOfCategory(Category=categories)
elevation = Level.Elevation(level=all_elements_of_category)
number = DoubleInput(0)
ge = elevation >= number
filterByBoolMask = List.FilterByBoolMask(list=all_elements_of_category, mask=ge)
watch = Watch(filterByBoolMask.in)
eq = elevation == number
if_ = If(test=eq)  # unwired: true, false
watch_2 = Watch(filterByBoolMask.out)
elevation_2 = Level.Elevation(level=filterByBoolMask.in)
eq_2 = elevation_2 == number
filterByBoolMask_2 = List.FilterByBoolMask(list=filterByBoolMask.in, mask=eq_2)
name = Level.Name(level=filterByBoolMask_2.in)
watch_3 = Watch(name)
elevation_3 = Level.Elevation(level=filterByBoolMask_2.out)
groupByKey = List.GroupByKey(list=filterByBoolMask_2.out, keys=elevation_3)
sortByKey = List.SortByKey(list=groupByKey.groups, keys=groupByKey.unique_keys)
name_2 = Level.Name(level=sortByKey.sorted_list)
elevation_4 = Level.Elevation(level=filterByBoolMask.out)
groupByKey_2 = List.GroupByKey(list=filterByBoolMask.out, keys=elevation_4)
sortByKey_2 = List.SortByKey(list=groupByKey_2.groups, keys=groupByKey_2.unique_keys)
watch_4 = Watch(sortByKey_2.sorted_list)
watch_5 = Watch(sortByKey.sorted_list)
count = List.Count(list=sortByKey.sorted_list)
string = StringInput("F-")
flatten = List.Flatten(list=sortByKey.sorted_list)
indexOf = List.IndexOf(list=flatten, element=flatten)
number_2 = DoubleInput(1)
add = indexOf + number_2
string_from_object = FromObject(obj=add)
number_3 = DoubleInput(2)
string_2 = StringInput("0")
padLeft = String.PadLeft(str=string_from_object, newWidth=number_3, padChars=string_2)
add_2 = string + padLeft
list_create = List.Create(item0=sortByKey.sorted_list, item1=add_2)
transpose = List.Transpose(lists=list_create)
watch_6 = Watch(transpose)
categories_2 = Categories(index=602)
all_elements_of_category_2 = ElementsOfCategory(Category=categories_2)
isNull = Object.IsNull(obj=all_elements_of_category_2)
not_ = Not(x=isNull)
filterByBoolMask_3 = List.FilterByBoolMask(list=all_elements_of_category_2, mask=not_)
type = Custom[View.Type](view=filterByBoolMask_3.in)  # Returns the type of a given view
string_3 = StringInput("FloorPlan")
filterByString = Custom[List.FilterByString](list=filterByBoolMask_3.in, String=string_3)  # Filter a list by a string match
watch_7 = Watch(filterByString.Match)
string_4 = StringInput("AreaPlan")
filterByString_2 = Custom[List.FilterByString](list=filterByString.Other, String=string_4)
watch_8 = Watch(filterByString_2.Match)
string_5 = StringInput("CeilingPlan")
filterByString_3 = Custom[List.FilterByString](list=filterByString.Other, String=string_5)
list_create_2 = List.Create(item0=filterByString.Match, item1=filterByString_2.Match, item2=filterByString_3.Match)
watch_9 = Watch(list_create_2)
isViewTemplate = View.IsViewTemplate(view=list_create_2)
not_2 = Not(x=isViewTemplate)
filterByBoolMask_4 = List.FilterByBoolMask(list=list_create_2, mask=not_2)
string_6 = StringInput("Associated Level")
getParameterValueByName = Element.GetParameterValueByName(element=filterByBoolMask_4.in, parameterName=string_6)
watch_10 = Watch(getParameterValueByName)
string_7 = StringInput("B-")
flatten_2 = List.Flatten(list=sortByKey_2.sorted_list)
indexOf_2 = List.IndexOf(list=flatten_2, element=flatten_2)
number_4 = DoubleInput(1)
add_3 = indexOf_2 + number_4
string_from_object_2 = FromObject(obj=add_3)
number_5 = DoubleInput(2)
string_8 = StringInput("0")
padLeft_2 = String.PadLeft(str=string_from_object_2, newWidth=number_5, padChars=string_8)
add_4 = string_7 + padLeft_2
list_create_3 = List.Create(item0=sortByKey_2.sorted_list, item1=add_4)
transpose_2 = List.Transpose(lists=list_create_3)
watch_11 = Watch(transpose_2)
string_9 = StringInput("GF")
list_create_4 = List.Create(item0=name, item1=string_9)
list_create_5 = List.Create(item0=list_create_4, item1=transpose, item2=transpose_2)
watch_12 = Watch(list_create_5)
flatten_3 = List.Flatten(list=list_create_5)
watch_13 = Watch(flatten_3)
parameters = Element.Parameters(element=list_create_2)
code_block = CodeBlock { [340.0,1020.0]; }
firstItem = List.FirstItem(list=transpose, lacing=CrossProduct)
firstItem_2 = List.FirstItem(list=firstItem, lacing=CrossProduct)
elevation_5 = Level.Elevation(level=firstItem_2)
code_block_2 = CodeBlock { 2; }
round = Math.Round(number=elevation_5, digits=code_block_2)
contains = List.Contains(list=code_block, item=round, lacing=Longest)
filterByBoolMask_5 = List.FilterByBoolMask(list=transpose, mask=contains)
watch_14 = Watch(round)
watch_15 = Watch(contains)
categories_3 = Categories(index=248)
all_elements_of_category_3 = ElementsOfCategory(Category=categories_3)
code_block_3 = CodeBlock { [340.0,1020.0]; }
python_script = Python(IN[0]=all_elements_of_category_3, IN[1]=code_block_3)
# ---------- python_script.python (51 lines) ----------
import clr
#----------------------------------------------------
clr.AddReference('RevitAPI')
from Autodesk.Revit.DB import *
from Autodesk.Revit.DB.Structure import *
#----------------------------------------------------
clr.AddReference('RevitAPIUI')
from Autodesk.Revit.UI import *
#----------------------------------------------------
clr.AddReference('System')
from System.Collections.Generic import List
#----------------------------------------------------
clr.AddReference('RevitNodes')
import Revit
clr.ImportExtensions(Revit.GeometryConversion)
clr.ImportExtensions(Revit.Elements)
#----------------------------------------------------
clr.AddReference('RevitServices')
import RevitServices
from RevitServices.Persistence import DocumentManager
from RevitServices.Transactions import TransactionManager
#----------------------------------------------------
doc   = DocumentManager.Instance.CurrentDBDocument
uidoc = DocumentManager.Instance.CurrentUIApplication.ActiveUIDocument
#----------------------------------------------------
import math
#----------------------------------------------------

#Preparing input from dynamo to revit
# elements = UnwrapElement(IN[0])
#----------------------------------------------------
def jt_toInternalUnits(lengthValue):
	return UnitUtils.ConvertToInternalUnits(lengthValue,Document.GetUnits(doc).GetFormatOptions(UnitType.UT_Length).DisplayUnits)
def jt_FromIntUnits(lengthValue ):
	return UnitUtils.ConvertFromInternalUnits(lengthValue,Document.GetUnits(doc).GetFormatOptions(UnitType.UT_Length).DisplayUnits)

if isinstance(IN[0],list):
	elements=UnwrapElement(IN[0])
else:
	elements=[UnwrapElement(IN[0])]
output = []
for e in elements:
	output.append([e.Name,round(jt_FromIntUnits(e.Elevation),2)])
#Do some action in a Transaction
#TransactionManager.Instance.EnsureInTransaction(doc)
# do something
#TransactionManager.Instance.TransactionTaskDone()
#----------------------------------------------------
output.sort(key = lambda x : x[1]);

OUT = output
# ----------------------------------------
watch_16 = Watch(python_script)
