# Dynamo graph libupdate-2.dyn (Dynamo 2.0.0.4654)

# group: Get a list of rfa files
directory_path = Directory("C:\7777")  # graph input
directory_from_path = DirectoryObject(path=directory_path)
string = StringInput("*.rfa")
include_sub_directories = BoolSelector(true)  # graph input
getDirectoryContents = FileSystem.GetDirectoryContents(directory=directory_from_path, searchString=string, includeSubdirectories=include_sub_directories)

boolean = BoolSelector(false)

# group: Open and optionally save rfa files. Using Rhythm package
openDocumentFile = Rhythm.Revit.Application.Application.OpenDocumentFile(filePath=getDirectoryContents.files, audit=boolean, detachFromCentral=boolean)
save_rfa_file = BoolSelector(true)  # graph input
closeDocument = Rhythm.Revit.Application.Application.CloseDocument(document=openDocumentFile, save=save_rfa_file)

watch = Watch(closeDocument)
