# Dynamo graph libupdate.dyn "libupdate-2" (Dynamo 2.0.3.8810)

directory_path = Directory("C:\7777")  # graph input
directory_from_path = DirectoryObject(path=directory_path)
string = StringInput("*.rfa")
include_sub_directories = BoolSelector(true)  # graph input
getDirectoryContents = FileSystem.GetDirectoryContents(directory=directory_from_path, searchString=string, includeSubdirectories=include_sub_directories)
boolean = BoolSelector(true)
boolean_2 = BoolSelector(false)

# group: Open and optionally save rfa files. Using Rhythm package
ʳʰʸᵗʰᵐ_applications = Rhythm.Revit.Application.Applications.OpenDocumentFile(filePath=getDirectoryContents.files, audit=boolean, detachFromCentral=boolean_2, preserveWorksets=boolean_2)
save_rfa_file = BoolSelector(true)  # graph input
ʳʰʸᵗʰᵐ_applications_2 = Rhythm.Revit.Application.Applications.CloseDocument(document=ʳʰʸᵗʰᵐ_applications, save=save_rfa_file)

watch = Watch(ʳʰʸᵗʰᵐ_applications_2)
