# Dynamo graph model-groups-01.dyn (Dynamo 2.0.1.5055)

categories = Categories(index=326)
all_elements_of_category = ElementsOfCategory(Category=categories)
python_script = Python(IN[0]=all_elements_of_category)
# ---------- python_script.python (47 lines) ----------
# Enable Python support and load DesignScript library
import clr
clr.AddReference('ProtoGeometry')
from Autodesk.DesignScript.Geometry import *

# The inputs to this node will be stored as a list in the IN variables.


# Place your code below this line

# Assign your output to the OUT variable.





# The inputs to this node will be stored as a list in the IN variables.
modelGroups = IN[0]



def get_group_names(allgroups):
	group_names = []
	for x in allgroups:
		if x.Name not in group_names:
			group_names.append(x.Name)
	return group_names

def get_count_instances(group_name , allgroups):
	total = 0;
	for x in allgroups:
		if x.Name == group_name:
			total +=1
	return total
	
model_groups_names  = get_group_names(modelGroups)
output = []

for x in model_groups_names:
	i = get_count_instances(x, modelGroups)
	output.append([x,i,])

# Place your code below this line

mg = modelGroups[3]

OUT =  dir(mg),output
# ----------------------------------------
watch = Watch(python_script)
python_script_2 = Python(IN[0]=all_elements_of_category)  # frozen
# ---------- python_script_2.python (40 lines) ----------
# Enable Python support and load DesignScript library
import clr
clr.AddReference('ProtoGeometry')
clr.AddReference('RevitAPI')
clr.AddReference('RevitNodes')
from Autodesk.DesignScript.Geometry import *
import Revit
clr.ImportExtensions(Revit.Elements)

# The inputs to this node will be stored as a list in the IN variables.
modelGroups = IN[0]

# Place your code below this line

def get_group_names(allgroups):
	group_names = []
	for x in allgroups:
		if x.Name not in group_names:
			group_names.append(x.Name)
	return group_names

def get_count_instances(group_name , allgroups):
	total = 0;
	for x in allgroups:
		if x.Name == group_name:
			total +=1
	return total


model_groups_names  = get_group_names(modelGroups)
output = []

for x in model_groups_names:
	i = get_count_instances(x, modelGroups)
	output.append([x,i,])
		
mg = modelGroups[3]
bb = mg.BoundingBox

OUT =  dir(mg),output
# ----------------------------------------
watch_2 = Watch(all_elements_of_category)
