# Dynamo graph model-groups.dyn (Dynamo 2.0.2.6826)

categories = Categories(index=320)
all_elements_of_category = ElementsOfCategory(Category=categories)
python_script = Python(IN[0]=all_elements_of_category)
# ---------- python_script.python (30 lines) ----------
# Enable Python support and load DesignScript library
import clr
clr.AddReference('ProtoGeometry')
from Autodesk.DesignScript.Geometry import *

## The inputs to this node will be stored as a list in the IN variables.
##
##
modelGroups = IN[0]
##
## Place your code below this line
##
## Assign your output to the OUT variable.
##


g_names = []
mgs_count = len(modelGroups)
for x in modelGroups:
	if (x.Name not in g_names):
		g_names.append(x.Name)

boxes = [] 
for x in modelGroups:
	boxes.append(x.BoundingBox)
	

##OUT = mgs_count,g_names,len(g_names)
OUT = boxes
##
# ----------------------------------------
maxPoint = BoundingBox.MaxPoint(boundingBox=python_script)
watch = Watch(maxPoint)
minPoint = BoundingBox.MinPoint(boundingBox=python_script)
watch_2 = Watch(minPoint)
toCuboid = BoundingBox.ToCuboid(boundingBox=python_script)
watch_3 = Watch(toCuboid)
