# Dynamo graph mys_custom_sheets_list.dyn (Dynamo 2.0.1.5055)

# group: קובץ אקסל מודל + MYS-SheetList- שם תאריך
string = StringInput("MYS-SheetList-")  # graph input
now = DateTime.Now()
string_2 = StringInput("yyyy-MM-dd")  # graph input
format = DateTime.Format(dateTime=now, format=string_2)
string_3 = StringInput(".xlsx")  # graph input
concat = String.Concat(string0=string, string1=format, string2=string_3)
python_script = Python(IN[0]=concat)
# ---------- python_script.python (36 lines) ----------
import clr

import sys
sys.path.append(r'C:\Program Files (x86)\IronPython 2.7\Lib')
import os   
# importing os without appending to path raises Import Error


clr.AddReference('ProtoGeometry')
from Autodesk.DesignScript.Geometry import *

#The inputs to this node will be stored as a list in the IN variables.
dataEnteringNode = IN


clr.AddReference('RevitAPI')
clr.AddReference('RevitServices')

from Autodesk.Revit.ApplicationServices import *
from Autodesk.Revit.DB import *
import RevitServices
from RevitServices.Persistence import DocumentManager
from RevitServices.Transactions import TransactionManager

doc = DocumentManager.Instance.CurrentDBDocument
uiapp = DocumentManager.Instance.CurrentUIApplication
app = uiapp.Application
uidoc=DocumentManager.Instance.CurrentUIApplication.ActiveUIDocument


fp = BasicFileInfo.Extract(doc.PathName).CentralPath

d = os.path.splitext(fp)[0] + dataEnteringNode[0]

#Assign your output to the OUT variable.
OUT = d
# ----------------------------------------
watch = Watch(python_script)

string_4 = StringInput("SheetsList")
number = DoubleInput(0)
family_types = FamilyTypes(index=170)
all_elements_of_family_type = ElementsOfFamilyType(Family_Type=family_types)
python_script_2 = Python(IN[0]=all_elements_of_family_type)
# ---------- python_script_2.python (28 lines) ----------
# Enable Python support and load DesignScript library
import clr
clr.AddReference('ProtoGeometry')
from Autodesk.DesignScript.Geometry import *

# The inputs to this node will be stored as a list in the IN variables.
dat = IN[0]

# Place your code below this line
sheets_data = []
for sht in dat:
	f = [[a.Name, a.Value] for a in sht.Parameters]
	sheets_data.append(f)

spreadsheet_data = []
header = []
for x in sheets_data[0]:
	header.append(x[0])

spreadsheet_data.append(header)

for sht in sheets_data:
	row = []
	for a in sht:
		row.append(a[1])
	spreadsheet_data.append(row)

OUT = spreadsheet_data
# ----------------------------------------
boolean = BoolSelector(true)
exportExcel = Data.ExportExcel(filePath=python_script, sheetName=string_4, startRow=number, startCol=number, data=python_script_2, overWrite=boolean)
watch_2 = Watch(exportExcel)
watch_3 = Watch(python_script_2)
