# Dynamo graph sheet-read.dyn (Dynamo 2.0.1.5055)

categories = Categories(index=422)
all_elements_of_category = ElementsOfCategory(Category=categories)
python_script = Python(IN[0]=all_elements_of_category)
# ---------- python_script.python (23 lines) ----------
# Enable Python support and load DesignScript library
import clr
clr.AddReference('ProtoGeometry')
from Autodesk.DesignScript.Geometry import *

# The inputs to this node will be stored as a list in the IN variables.
dataEnteringNode = IN

#OUT = dir(IN[0][0])
# Place your code below this line
#OUT = (IN[0][0]).GetType()
#OUT = dir(IN[0][0])
#OUT = (IN[0][1]).UniqueId
#OUT = (IN[0][1]).ElementType
#OUT = (IN[0][1]).Parameters

v = []
for x in IN[0]:
	v.append(x.Views)
	
OUT = v

#OUT = Parameters(IN[0][0])
# ----------------------------------------
watch = Watch(python_script)
string = StringInput("Title block")
getParameterValueByName = Element.GetParameterValueByName(element=all_elements_of_category, parameterName=string)
watch_2 = Watch(getParameterValueByName)
