# Dynamo graph sheets-selection-with-python.dyn (Dynamo 2.0.1.5055)

python_script_collect_sheets = Python()  # unwired: IN[0]
# ---------- python_script_collect_sheets.python (60 lines) ----------
import clr
clr.AddReference('RevitAPI')
from Autodesk.Revit.DB import *
import Autodesk

clr.AddReference("RevitServices")
import RevitServices
from RevitServices.Persistence import DocumentManager


########
def collect_params(param_element):
    """
    Collects parameters of the provided element.
    Args:
        param_element: Element that holds the parameters.
    Returns:
        Returns a dictionary, with parameters.
    """

    parameters = param_element.Parameters
    param_dict = defaultdict(list)

    for param in parameters:
        param_dict[param.Definition.Name].append(param.StorageType.ToString().split(".")[-1])
        param_dict[param.Definition.Name].append(param.HasValue)

        param_value = None
        if param.HasValue:
            if param.StorageType.ToString() == "ElementId":
                param_value = param.AsElementId().IntegerValue
            elif param.StorageType.ToString() == "Integer":
                param_value = param.AsInteger()
            elif param.StorageType.ToString() == "Double":
                param_value = param.AsDouble()
            elif param.StorageType.ToString() == "String":
                param_value = param.AsString()
        param_dict[param.Definition.Name].append(str(param_value))

    return param_dict
#########

doc = DocumentManager.Instance.CurrentDBDocument
collector = FilteredElementCollector(doc)
sheets = FilteredElementCollector(doc).OfCategory(BuiltInCategory.OST_Sheets).ToElements()
#sheets = collector.OfClass(BuiltInCategory.OST_Sheets).ToElements()
sheetlist = []




for sht in sheets:
	sheetlist.append(sht)

sht2 = sheets[1]

sht2p = collect_params(sht2)


OUT = sht2.ViewName,sht2.SheetNumber,sht2p
# ----------------------------------------
type = Object.Type(obj=python_script_collect_sheets)
watch = Watch(type)
watch_2 = Watch(python_script_collect_sheets)
