# Dynamo graph skin1467.dyn (Dynamo 2.0.1.5055)

# group: one time
code_block = CodeBlock { 0; 0; 0; }
byCoordinates = Point.ByCoordinates(x=code_block.out0, y=code_block.out1, z=code_block.out2)  # frozen
code_block_2 = CodeBlock { 140; 0; 0; }
byCoordinates_2 = Point.ByCoordinates(x=code_block_2.out0, y=code_block_2.out1, z=code_block_2.out2)  # frozen
code_block_3 = CodeBlock { 140; -20; 420; }
byCoordinates_3 = Point.ByCoordinates(x=code_block_3.out0, y=code_block_3.out1, z=code_block_3.out2)  # frozen
code_block_4 = CodeBlock { 0; -20; 420; }
byCoordinates_4 = Point.ByCoordinates(x=code_block_4.out0, y=code_block_4.out1, z=code_block_4.out2)  # frozen
create = List.Create(item0=byCoordinates, item1=byCoordinates_2, item2=byCoordinates_3, item3=byCoordinates_4)
boolean = BoolSelector(true)  # graph input
byPoints = PolyCurve.ByPoints(points=create, connectLastToFirst=boolean)  # frozen

create_2 = List.Create(item0=create)
family_types = FamilyTypes(index=4)  # graph input
byPoints_2 = AdaptiveComponent.ByPoints(points=create_2, familyType=family_types)  # frozen
file_path = Filename("..\..\7777\ProjectsWork_Revit2017\1467\Some_reflines.csv")  # graph input; frozen
boolean_2 = BoolSelector(true)  # graph input; frozen
importCSV = Data.ImportCSV(filePath=file_path, transpose=boolean_2)
number = DoubleInput(0)  # graph input
getItemAtIndex = List.GetItemAtIndex(list=importCSV, index=number, lacing=CrossProduct)
number_2 = DoubleInput(1)  # graph input
getItemAtIndex_2 = List.GetItemAtIndex(list=importCSV, index=number_2, lacing=CrossProduct)
number_3 = DoubleInput(2)  # graph input
getItemAtIndex_3 = List.GetItemAtIndex(list=importCSV, index=number_3, lacing=CrossProduct)
byCoordinates_5 = Point.ByCoordinates(x=getItemAtIndex, y=getItemAtIndex_2, z=getItemAtIndex_3)
number_4 = DoubleInput(3)  # graph input
getItemAtIndex_4 = List.GetItemAtIndex(list=importCSV, index=number_4, lacing=CrossProduct)
number_5 = DoubleInput(4)  # graph input
getItemAtIndex_5 = List.GetItemAtIndex(list=importCSV, index=number_5, lacing=CrossProduct)
number_6 = DoubleInput(5)  # graph input
getItemAtIndex_6 = List.GetItemAtIndex(list=importCSV, index=number_6, lacing=CrossProduct)
byCoordinates_6 = Point.ByCoordinates(x=getItemAtIndex_4, y=getItemAtIndex_5, z=getItemAtIndex_6)
byStartPointEndPoint = Line.ByStartPointEndPoint(startPoint=byCoordinates_5, endPoint=byCoordinates_6)  # frozen
byCurve = ModelCurve.ByCurve(curve=byStartPointEndPoint)
file_path_2 = Filename("..\..\7777\ProjectsWork_Revit2017\1467\ptss.csv")  # graph input; frozen
boolean_3 = BoolSelector(true)  # graph input; frozen
importCSV_2 = Data.ImportCSV(filePath=file_path_2, transpose=boolean_3)
watch = Watch(importCSV_2)
categories = Categories(index=241)
all_elements_of_category = ElementsOfCategory(Category=categories)
string = StringInput("Length")
getParameterValueByName = Element.GetParameterValueByName(element=all_elements_of_category, parameterName=string)
number_7 = DoubleInput(145)
div = getParameterValueByName / number_7
watch_2 = Watch(div)
curve = CurveElement.Curve(curveElement=all_elements_of_category)
watch_3 = Watch(curve)
pointAtSegmentLength = Curve.PointAtSegmentLength(lacing=CrossProduct)  # unwired: curve
round = Math.Round(number=div)
div_2 = getParameterValueByName / round
watch_4 = Watch(div_2)
python_script = Python(IN[0]=all_elements_of_category)
# ---------- python_script.python (34 lines) ----------
# Enable Python support and load DesignScript library
import clr
import System

clr.AddReference('ProtoGeometry')
from Autodesk.DesignScript.Geometry import *

import PythomMath



#mods = None
#for a in System.AppDomain.CurrentDomain.GetAssemblies():
#	if 'IronPython.Modules' == a.GetName().Name:
#		mods = a 
#		break
#if mods is not None:
#	modsav = [m.Key for m in mods.IronPython.Modules]
	

curves = IN[0]


# The inputs to this node will be stored as a list in the IN variables.
# Place your code below this line



pts = []



# Assign your output to the OUT variable.
OUT = modsav
# ----------------------------------------
watch_5 = Watch(python_script)
